# Grasshopper definition Configurator_Element_Debug.gh (Grasshopper 1.0.8)

add_to_sys_path = Script()
# ---------- add_to_sys_path: Python ----------
import sys, os

project_root = r"E:\ARCH\Nexus\Nexus_Mind"            # ← adjust to your folder
src_folder    = os.path.join(project_root, "src")
if src_folder not in sys.path:
    sys.path.insert(0, src_folder)
# ---------- end add_to_sys_path ----------
file_path = FilePath("E:\ARCH\Nexus\Nexus_Mind\src\mind\config\Solver_Solutions\NX_ELEMENT_28_SOLUTION.json")
file_path_2 = FilePath("E:\ARCH\Nexus\Nexus_Mind\src\mind\config\Solver_Solutions\NX_ELEMENT_28_PLOT.json")
level = GetInteger(Slider(1, range=0..3), AtLeast=1, AtMost=1, Maximum=2147483647, Minimum=-2147483648, TreeAccess=False)
plot_json = GetString(file_path_2, AtLeast=1, AtMost=1, TreeAccess=False)
solution_json = GetString(file_path, AtLeast=1, AtMost=1, TreeAccess=False)
context_print = ContextPrint(Text=level)
file_path_3 = FilePath("E:\dbom²\Nexus - Nexus\05_CAD\04_Model\Nexus_Element\NX_ELEMENT - MODULES.3dm")
moules_file_path = GetString(file_path_3, AtLeast=1, AtMost=1, TreeAccess=False)
concatenate = Concatenate(Fragment_A="FLOOR_PLAN", Fragment_B="28", A="LVL", B=level, JoinSeparator="_")
file_path_4 = FilePath("E:\ARCH\Nexus\Nexus_Mind\Nexus_Element_Configurator\SVG\")
svg_folder_path = GetString(file_path_4, AtLeast=1, AtMost=1, TreeAccess=False)
svg_file_name = GetString(concatenate, AtLeast=1, AtMost=1, TreeAccess=False)
context_print_2 = ContextPrint(Text=svg_file_name)
