# Grasshopper definition Configurator_Element_Drawings.gh (Grasshopper 1.0.8)
# plug-ins: GraphicPlus

add_to_sys_path = Script()
# ---------- add_to_sys_path: Python ----------
import sys, os

project_root = r"E:\ARCH\Nexus\Nexus_Mind"            # ← adjust to your folder
src_folder    = os.path.join(project_root, "src")
if src_folder not in sys.path:
    sys.path.insert(0, src_folder)
# ---------- end add_to_sys_path ----------
file_path = FilePath("E:\ARCH\Nexus\Website\Nexus-Website\assets\data\NX_ELEMENT_28_PLOT.json")  # disabled
script = Script(x=file_path)  # -> a; inputs x: String; disabled
# ---------- script: Python ----------
with open(x, 'r') as f:
    a = f.read()
# ---------- end script ----------
file_path_2 = FilePath("E:\ARCH\Nexus\Website\Nexus-Website\assets\data\NX_ELEMENT_28_SOLUTION.json")  # disabled
level = GetInteger(Slider(1, range=0..3), AtLeast=1, AtMost=1, Maximum=2147483647, Minimum=-2147483648, TreeAccess=False)
script_2 = Script(x=file_path_2)  # -> a; inputs x: String; disabled; same code as script
plot_json = GetString(script, AtLeast=1, AtMost=1, TreeAccess=False)
panel = Panel(plot_json)
solution_json = GetString(script_2, AtLeast=1, AtMost=1, TreeAccess=False)

# ---- group: PLOT
panel_2 = Panel("""S
E
N
W""")
plot = Script(response=plot_json)  # -> out, north_angle, building_site_size_X, building_site_size_Y, setback_S, setback_E, setback_N, setback_W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; inputs response: String
# ---------- plot: Python ----------
import json
response = json.loads(response)


north_angle = response["north_angle"]
building_site_size_X = response["building_site_size"][0]
building_site_size_Y = response["building_site_size"][1]
setback_S = response["setbacks"]["S"]
setback_E = response["setbacks"]["E"]
setback_N = response["setbacks"]["N"]
setback_W = response["setbacks"]["W"]
access_S = response["access"]["S"]
access_E = response["access"]["E"]
access_N = response["access"]["N"]
access_W = response["access"]["W"]
# ---------- end plot ----------
text = Text(panel_2)
level_2 = Number(Slider(3, range=0..10))
grid_size = Number("3.75")
merge = Merge(Data1=plot.setback_S, Data2=plot.setback_E, Data3=plot.setback_N, Data4=plot.setback_W)
merge_2 = Merge(Data1=plot.access_S, Data2=plot.access_E, Data3=plot.access_N, Data4=plot.access_W)
north_angle = Number(plot.north_angle)
plot_length = Number(plot.building_site_size_Y)
pedestrian_access = Boolean(merge_2)
plot_width = Number(plot.building_site_size_X)
seatback = Number(merge)
lat = Number("49.450065")
lon = Number("10.967395")
E = Slider(10, range=1.5..20)
S = Slider(15, range=1.5..20)
N = Slider(5, range=1.5..10)
W = Slider(3, range=1.5..10)
merge_3 = Merge(Data1=plot_width, Data2=plot_length)
merge_4 = Merge(Data1=S, Data2=E, Data3=N, Data4=W)
neighbour_distance = Number(merge_4)

# ---- group: ARCH_PARAMS
floor_d = Number(Slider(0.15, range=0..1))
floor_h = Number(Slider(3, range=0..10))
beam_h = Number(Slider(0.5, range=0..1))
insulation_width = Number(Slider(0.15, range=0..1))
cladding_width = Number(Slider(0.625, range=0..1))
core_width = Number(Slider(0.15, range=0..1))
floor_h_2 = Number(floor_h)
floor_d_2 = Number(floor_d)
beam_h_2 = Number(beam_h)

# ----
file_path_3 = FilePath("E:\ARCH\Nexus\Website\Nexus-Website\assets\rhino\NX_ELEMENT_MODULES.3dm")
moules_file_path = GetString(file_path_3, AtLeast=1, AtMost=1, TreeAccess=False)
import_content = ImportContent(FilePath=moules_file_path, Import=True)
setting_file_units = Script(x=import_content)  # -> x; inputs x: tree
# ---------- setting_file_units: Python ----------
import Rhino as rh
import scriptcontext as sc

newDoc = rh.RhinoDoc.CreateHeadless(None)
newDoc.ModelUnitSystem = rh.UnitSystem.Meters
rh.RhinoDoc.ActiveDoc = newDoc

a = rh.RhinoDoc.ActiveDoc.ModelUnitSystem


print(f"Log from grasshopper - Testing for unit system: {a}")
# ---------- end setting_file_units ----------

# ---- group: LOGGING FOR DEBUG
convert_units = ConvertUnits(Data=1, Source=1, Target=4)
script_3 = Script(x=convert_units)
# ---------- script_3: Python ----------
print(f"Double checking of conversion units: {x}")
# ---------- end script_3 ----------

# ----
plot_length_2 = Number(plot_length)
plot_width_2 = Number(plot_width)
cluster = Cluster_3(grid_size=grid_size, plot_width=plot_width, plot_length=plot_length, seatback=seatback)  # -> rectangle_2, plane_2

# ---- group: SUN SETTINGS
north_angle_2 = Number(expr("x+90", north_angle))
lat_2 = Number(lat)
lon_2 = Number(lon)
sun = Sun(Enabled=Toggle(True), Latitude=degrees(lat_2), Longitude=degrees(lon_2), North=degrees(north_angle_2))  # -> Sun, Enabled, Intensity, DateTime, degrees(Latitude), degrees(Longitude), degrees(North)

# ----
number_slider = Slider(1, range=0..1)
equality_filter = EqualityFilter(Value="Annotation")  # -> Equal, Unequal
equality_filter_2 = EqualityFilter(Value="Curve")  # -> Equal, Unequal
equality_filter_3 = EqualityFilter(Value="Annotation")  # -> Equal, Unequal
contains_text_filter = ContainsTextFilter(Text="200_ANNO::200_MODULE_TAG", Case=True, Culture=127, ContainsTextMode=0)
contains_text_filter_2 = ContainsTextFilter(Text="300_DRAFTING::300_ENT", Case=True, Culture=127, ContainsTextMode=0)
contains_text_filter_3 = ContainsTextFilter(Text="100_REF", Case=True, Culture=127, ContainsTextMode=0)
contains_text_filter_4 = ContainsTextFilter(Text="200_ANNO::200_PART_TAG", Case=True, Culture=127, ContainsTextMode=0)
contains_text_filter_5 = ContainsTextFilter(Text="400_MODEL", Case=True, Culture=127, ContainsTextMode=0)
logical_or_filter = LogicalOrFilter(FilterA=equality_filter_2.Equal, FilterB=equality_filter_3.Equal)
logical_not_filter = LogicalNotFilter(Filter=contains_text_filter)
logical_not_filter_2 = LogicalNotFilter(Filter=contains_text_filter_3)
logical_not_filter_3 = LogicalNotFilter(Filter=contains_text_filter_2)
logical_not_filter_4 = LogicalNotFilter(Filter=contains_text_filter_4)
logical_not_filter_5 = LogicalNotFilter(Filter=contains_text_filter_5)
logical_and_filter = LogicalAndFilter(FilterA=equality_filter_2.Equal, FilterB=logical_not_filter_2)
contains_text_filter_6 = ContainsTextFilter(Text="200_ANNO::200_MODULE_TAG", Case=True, Culture=127, ContainsTextMode=0)
contains_text_filter_7 = ContainsTextFilter(Text="200_ANNO::200_PART_TAG", Case=True, Culture=127, ContainsTextMode=0)
logical_and_filter_2 = LogicalAndFilter(FilterA=logical_and_filter, FilterB=logical_not_filter_3)
equality_filter_4 = EqualityFilter(Value="Annotation")  # -> Equal, Unequal
logical_not_filter_6 = LogicalNotFilter(Filter=contains_text_filter_6)
logical_not_filter_7 = LogicalNotFilter(Filter=contains_text_filter_7)
logical_and_filter_3 = LogicalAndFilter(FilterA=logical_and_filter_2, FilterB=logical_not_filter_5)
logical_and_filter_4 = LogicalAndFilter(FilterA=logical_not_filter, FilterB=logical_not_filter_4)
logical_and_filter_5 = LogicalAndFilter(FilterA=logical_and_filter_3, FilterB=logical_and_filter_4)
logical_and_filter_6 = LogicalAndFilter(FilterA=logical_not_filter_7, FilterB=equality_filter_4.Equal)
logical_and_filter_7 = LogicalAndFilter(FilterA=logical_not_filter_6, FilterB=logical_and_filter_6)
panel_3 = Panel("900")

level_3 = Integer(level)
unpack_partitions = Script(level=level_3, response=solution_json)  # -> out, type_id, x, y, rotation, flip; inputs level: Int32
# ---------- unpack_partitions: Python ----------
import json

result = json.loads(response)

name = []
type_id = []
x = []
y = []

rotation = []
flip = []
for partition in result["house"]["partitions"]:
    l = partition['level']
    if l == level:
        type_id.append(partition["type"])
        x.append(partition['cell'][0])
        y.append(partition['cell'][1])
        rotation.append(partition["rotation"])
        flip.append(partition["flip"])
# ---------- end unpack_partitions ----------
unpack_modules = Script(level=level_3, response=solution_json)  # -> out, name, type_id, x, y, rotation, flip, is_indoor; inputs level: Int32
# ---------- unpack_modules: Python ----------
import json

result = json.loads(response)
grid_shape = result['house']['grid_shape']
num_levels = grid_shape[2]

name = []
type_id = []
x = []
y = []
rotation = []
flip = []
is_indoor = []
for module in result['house']['modules']:
    l = module['position'][2]
    if l == level:
        name.append(module['name'])
        t = module['type']
        type_id.append(t)
        x.append(module['position'][0])
        y.append(module['position'][1])
        rotation.append(module['rotation'])
        flip.append(module['flip'])
        is_indoor.append(module['is_indoor'])
# ---------- end unpack_modules ----------

equality_filter_5 = EqualityFilter(Value=unpack_modules.type_id)  # -> Equal, Unequal
equality_filter_6 = EqualityFilter(Value=unpack_partitions.type_id)  # -> Equal, Unequal
filter_content = FilterContent(Content=setting_file_units, Filter=equality_filter_6.Equal)  # -> flatten(Content)
filter_content_2 = FilterContent(Content=setting_file_units, Filter=equality_filter_5.Equal)  # -> flatten(Content)
model_block_definition = ModelBlockDefinition(filter_content_2)
model_block_definition_2 = ModelBlockDefinition(filter_content)
boolean = Boolean(unpack_modules.is_indoor)

construct_domain = ConstructDomain(DomainStart=0, DomainEnd=plot_width_2)
construct_domain_2 = ConstructDomain(DomainStart=0, DomainEnd=plot_length_2)
rectangle = Rectangle(Plane=PlaneXY(0, 0, 0), XSize=construct_domain, YSize=construct_domain_2, Radius=0)  # -> Rectangle, Length
area = Area(Geometry=rectangle.Rectangle)  # -> Area, Centroid
point = Point(area.Centroid)

geometry = Geometry(rectangle.Rectangle)
plot_area = Panel(area.Area)
vector = Vector(expr("-X", point))

seatback_2 = Number(seatback)
list_item = ListItem(List=seatback_2, Index=0, Wrap=True)  # -> Item, Item1, Item2, Item3
addition = Addition(B=list_item.Item)
subtraction = Subtraction(A=plot_length_2, B=list_item.Item2)
addition_2 = Addition(B=list_item.Item3)
subtraction_2 = Subtraction(A=plot_width_2, B=list_item.Item1)
construct_domain_3 = ConstructDomain(DomainStart=addition_2, DomainEnd=subtraction_2)
construct_domain_4 = ConstructDomain(DomainStart=addition, DomainEnd=subtraction)
rectangle_2 = Rectangle(Plane=PlaneXY(0, 0, 0), XSize=construct_domain_3, YSize=construct_domain_4, Radius=0)  # -> Rectangle, Length
move = Move(Geometry=rectangle_2.Rectangle, Motion=vector)  # -> Geometry, Transform

move_2 = Move(Geometry=cluster.rectangle_2, Motion=vector)  # -> Geometry, Transform
move_3 = Move(Geometry=cluster.plane_2, Motion=vector)  # -> Geometry, Transform

cluster_2 = Cluster_7(
    level=level_3,
    grid=move_3.Geometry,
    x=unpack_partitions.x,
    y=unpack_partitions.y,
    B=level_2,
    rotate=unpack_partitions.rotation,
    flip=unpack_partitions.flip)  # -> module_plane_2, simplify(transform_2)
cluster_3 = Cluster_6(
    level=level_3,
    grid=move_3.Geometry,
    x=unpack_modules.x,
    y=unpack_modules.y,
    B=level_2,
    rotate=unpack_modules.rotation,
    flip=unpack_modules.flip)  # -> module_plane_2, transform_2

model_block_instance = ModelBlockInstance(Transform=cluster_3.transform_2, BlockDefinition=graft(model_block_definition))  # -> flatten(BlockInstance), flatten(Transform)
model_block_instance_2 = ModelBlockInstance(Transform=cluster_2.transform_2, BlockDefinition=graft(model_block_definition_2))  # -> flatten(BlockInstance), flatten(Transform)
curve = Curve(flatten(move_2.Geometry))
move_4 = Move(Geometry=geometry, Motion=vector)  # -> Geometry, Transform

cluster_4 = Cluster_2(geometry=move_4.Geometry)  # -> polyline_3, polyline_4
merge_5 = Merge(Data1=move_4.Geometry, Data2=move.Geometry)
cluster_5 = Cluster(curve_a=cluster_4.polyline_3, curve_b=merge_5)
cluster_6 = Cluster(curve_a=cluster_4.polyline_4, curve_b=merge_5)
drafting_attributes = DraftingAttributes(DrawOrder=Slider(10, range=0..10))
merge_6 = Merge(Data1=cluster_5, Data2=cluster_6)

explode = Explode(Curve=graft(curve), Recursive=True)  # -> simplify(Segments), Vertices
bounding_box = BoundingBox(Content=curve, Plane=PlaneXY(0, 0, 0), UnionBox=True)  # -> Box, Box_2

control_points = ControlPoints(Curve=move_4.Geometry)  # -> Points, Weights, Knots
script_4 = Script(x=control_points.Points)  # -> a; inputs x: list
# ---------- script_4: Python ----------
a = x[:-1]
# ---------- end script_4 ----------

rectangle_3 = Rectangle(bounding_box.Box)
point_2 = Point(flatten(explode.Vertices))
line = Line(explode.Segments)
flip_matrix = FlipMatrix(Data=line)
removeduplicatepts = RemoveDuplicatePts(Points=point_2, Tolerance=0.01)
model_object = ModelObject(Geometry=rectangle_3, Layer="200_ANNO::200_BOUNDING_BOX")  # -> Object, Geometry, Name, Layer, Visibility, Display, Drafting, Render
join_curves = JoinCurves(Curves=flip_matrix, Preserve=False)  # -> simplify(flatten(Curves))
circle = Circle(Plane=removeduplicatepts, Radius=Slider(0.05, range=0..0.1))
line_2 = Line(join_curves)
curve_2 = Curve(circle)
removeduplicatelines = RemoveDuplicateLines(Lines=line_2, Tolerance=0.01)
extend_curve = ExtendCurve(Curve=removeduplicatelines, Type=0, Start=number_slider, End=number_slider)
_2d_drawing = _2DDRAWING(
    block_instance=model_block_instance.BlockInstance,
    int_partition_block_instances=model_block_instance_2.BlockInstance,
    core_width=core_width,
    insulation_width=insulation_width,
    cladding_width=cladding_width,
    indoor_module=boolean)  # -> flatten(floor_2), flatten(curve_16), flatten(window_2)
model_object_2 = ModelObject(Geometry=curve_2, Layer="200_ANNO::200_MODULE_MARKERS")  # -> Object, Geometry, Name, Layer, Visibility, Display, Drafting, Render
model_object_3 = ModelObject(Geometry=extend_curve, Layer="200_ANNO::200_GRID")  # -> Object, Geometry, Name, Layer, Visibility, Display, Drafting, Render
join_curves_2 = JoinCurves(Curves=_2d_drawing.curve_16, Preserve=False)  # -> flatten(Curves)
explode_object = ExplodeObject(Object=model_block_instance.BlockInstance, Recursive=True)
explode_object_2 = ExplodeObject(Object=model_block_instance_2.BlockInstance, Recursive=True)
dim = DIM(geometry=join_curves_2)  # -> flatten(objects)
model_object_4 = ModelObject(Geometry=_2d_drawing.window_2, Layer="300_DRAFTING::300_WALL_ELE")
model_object_5 = ModelObject(Geometry=_2d_drawing.floor_2, Layer="300_DRAFTING::300_FLOOR_ELE")
model_object_6 = ModelObject(Geometry=join_curves_2, Layer="300_DRAFTING::300_WALL_CUT")
merge_7 = Merge(Data1=explode_object, Data2=explode_object_2)
filter_content_3 = FilterContent(Content=merge_7, Filter=equality_filter.Unequal)
data = Data(dim)
data_2 = Data(model_object_2.Object)
data_3 = Data(model_object_5)
data_4 = Data(model_object_3.Object)
data_5 = Data(model_object_6)
data_6 = Data(model_object_4)
data_7 = Data(filter_content_3)
merge_8 = Merge(Data1=data, Data2=data_2, Data3=data_4, Data4=data_5, Data5=data_6, Data6=data_7, Data7=data_3)  # -> flatten(Result)
model_object_7 = ModelObject(reverse(merge_8))
filter_content_4 = FilterContent(Content=model_object_7, Filter=logical_and_filter_5)
filter_content_5 = FilterContent(Content=model_object_7, Filter=logical_and_filter_7)
clean_tree = CleanTree(RemoveNulls=True, RemoveInvalid=True, RemoveEmpty=True, Tree=filter_content_4)
model_object_8 = ModelObject(Object=filter_content_5)  # -> Object, Geometry, Name, Layer, Visibility, Display, Drafting, Render
model_object_9 = ModelObject(Object=clean_tree)  # -> Object, Geometry, Name, Layer, Visibility, Display, Drafting, Render
text_entity = TextEntity(TextEntity=model_object_8.Object)  # -> TextEntity, Plane, Text, Style
content_identity = ContentIdentity(Content=model_object_8.Layer)  # -> Content, Id, Path
content_identity_2 = ContentIdentity(Content=model_object_9.Layer)  # -> Content, Id, Path
user_text = UserText(Content=model_object_9.Object, Keys="NAME", UserTextMode=1)  # -> Content, Keys, flatten(Values)
text_shape = TextShape(Text=text_entity.Text, Plane=text_entity.Plane)
shape_settings = ShapeSettings(ShapeGeometry=model_object_9.Geometry, Layer=content_identity_2.Path)
shape_settings_2 = ShapeSettings(ShapeGeometry=text_shape, Layer=content_identity.Path)
shape_tooltip = ShapeTooltip(ShapeGeometry=shape_settings, Text=user_text.Values)
data_8 = Data(model_object.Object)
offset_curve = OffsetCurve(Curve=data_8, Distance=Slider(2, range=0..10), Corners=1)
merge_9 = Merge(Data1=shape_settings_2, Data2=shape_tooltip)
rectangle_4 = Rectangle(offset_curve)
cluster_7 = Cluster_13(A="900", rectangle=rectangle_4)
integer = Integer(cluster_7)
construct_drawing = ConstructDrawing(ShapesGeometry=merge_9, Boundary=rectangle_4, Width="900", Height=integer, Color=RGBA(255, 255, 255, 0), Units=1)  # -> Drawing, Boundary
panel_4 = Panel(integer)
svg_text = SVGText(DrawingsShapesGeometry=construct_drawing.Drawing)
text_2 = Text(svg_text)
svg_str = ContextPrint(SVG_STRING=text_2)

# ==== cluster Cluster
curve_a = ClusterInput()
curve_b = ClusterInput()
curve_curve = CurveCurve(CurveA=curve_a, CurveB=curve_b)  # -> Points, ParamsA, ParamsB
create_set = CreateSet(List=flatten(curve_curve.ParamsA))  # -> Set, Map
list_item = ListItem(List=flatten(curve_curve.Points), Index=create_set.Map, Wrap=True)
sort_list = SortList(Keys=create_set.Set, ValuesValuesA=list_item)  # -> Keys, reverse(ValuesValuesA)
script = Script(x=sort_list.ValuesValuesA)  # -> out, a; inputs x: list
# ---------- script: Python ----------
a = [x[0], x[-1]]
# ---------- end script ----------
shift_list = ShiftList(List=sort_list.ValuesValuesA, Shift=1, Wrap=False)
shift_list_2 = ShiftList(List=script.a, Shift=1, Wrap=False)
shortest_list = ShortestList(ListListA=sort_list.ValuesValuesA, ListListB=shift_list, TrimMode=2)  # -> ListListA, ListListB
shortest_list_2 = ShortestList(ListListA=script.a, ListListB=shift_list_2, TrimMode=2)  # -> ListListA, ListListB
xy_plane = XYPlane(Origin=Point(0, 0, 0))
xy_plane_2 = XYPlane(Origin=Point(0, 0, 0))
aligned_dimension = AlignedDimension(
    Plane=xy_plane,
    PointA=shortest_list.ListListA,
    PointB=shortest_list.ListListB,
    Offset=Slider(1, range=0..10),
    Style=<geometry referenced from the Rhino model>)  # -> AlignedDimension, Plane, PointA, PointB, Offset, Style
aligned_dimension_2 = AlignedDimension(
    Plane=xy_plane_2,
    PointA=shortest_list_2.ListListA,
    PointB=shortest_list_2.ListListB,
    Offset=Slider(1.7, range=0..10),
    Style=<geometry referenced from the Rhino model>)  # -> AlignedDimension, Plane, PointA, PointB, Offset, Style
merge = Merge(Data1=aligned_dimension.AlignedDimension, Data2=aligned_dimension_2.AlignedDimension)
result = ClusterOutput(merge)

# ==== cluster Cluster_2
geometry = ClusterInput()
bounding_rectangle = BoundingRectangle(Geometry=geometry, Plane=PlaneXY(0, 0, 0), Axis=0, Slide=0, Union=True)  # -> Bounding, DimensionX, DimensionY
number_slider = Slider(0, range=0..100)
panel = Panel("""0.3
0.3""")
panel_2 = Panel("""0
1""")
panel_3 = Panel("""0.6
0.6""")
panel_4 = Panel("""0
1""")
evaluate_box = EvaluateBox(Box=bounding_rectangle.Bounding, UParameter=panel_2, VParameter=panel, WParameter=number_slider)  # -> Plane, Point, Include
evaluate_box_2 = EvaluateBox(Box=bounding_rectangle.Bounding, UParameter=panel_3, VParameter=panel_4, WParameter=number_slider)  # -> Plane, Point, Include
polyline = PolyLine(Vertices=evaluate_box_2.Point, Closed=False)
polyline_2 = PolyLine(Vertices=evaluate_box.Point, Closed=False)
polyline_3 = ClusterOutput(polyline)
polyline_4 = ClusterOutput(polyline_2)

# ==== cluster Cluster_3
plot_length = ClusterInput()
seatback = ClusterInput()
plot_width = ClusterInput()
grid_size = ClusterInput()
plot_length_2 = Number(plot_length)
seatback_2 = Number(seatback)
plot_width_2 = Number(plot_width)
grid_size_2 = Number(grid_size)
list_item = ListItem(List=seatback_2, Index=0, Wrap=True)  # -> Item, Item1, Item2, Item3
subtraction = Subtraction(A=plot_width_2, B=list_item.Item1, C=list_item.Item3)
subtraction_2 = Subtraction(A=plot_length_2, B=list_item.Item, C=list_item.Item2)
division = Division(A=subtraction, B=grid_size_2)
division_2 = Division(A=subtraction_2, B=grid_size_2)
round = Round(Number=division)  # -> Nearest, Floor, Ceiling
round_2 = Round(Number=division_2)  # -> Nearest, Floor, Ceiling
number = Number(expr("X*0.5", grid_size_2))
col = Integer(round.Floor)
row = Integer(round_2.Floor)
number_2 = Number(expr("X*0.5", subtraction))
number_3 = Number(expr("X*0.5", subtraction_2))
addition = Addition(A=number_2, B=list_item.Item1)
addition_2 = Addition(A=number_3, B=list_item.Item)
multiplication = Multiplication(A=col, B=grid_size_2)
multiplication_2 = Multiplication(A=row, B=grid_size_2)
series = Series(Start=number, Step=grid_size_2, Count=row)  # -> reverse(Series)
series_2 = Series(Start=number, Step=grid_size_2, Count=col)
number_4 = Number(expr("X*0.5", multiplication))
number_5 = Number(expr("X*0.5", multiplication_2))
subtraction_3 = Subtraction(A=addition, B=number_4)
subtraction_4 = Subtraction(A=addition_2, B=number_5)
construct_point = ConstructPoint(XCoordinate=series_2, YCoordinate=graft(series), ZCoordinate=0)
construct_point_2 = ConstructPoint(XCoordinate=subtraction_3, YCoordinate=subtraction_4, ZCoordinate=0)
move = Move(Geometry=construct_point, Motion=construct_point_2)  # -> Geometry, Transform
number_6 = Number(number)
construct_domain = ConstructDomain(DomainStart=expr("-X", number_6), DomainEnd=number_6)
xy_plane = XYPlane(Origin=move.Geometry)
rectangle = Rectangle(Plane=xy_plane, XSize=construct_domain, YSize=construct_domain, Radius=0)  # -> Rectangle, Length
plane = Plane(xy_plane)
plane_2 = ClusterOutput(plane)
rectangle_2 = ClusterOutput(rectangle.Rectangle)

# ==== cluster Cluster_6
x = ClusterInput()
y = ClusterInput()
x_2 = Integer(graft(x))
y_2 = Integer(graft(y))
merge = Merge(Data1=x_2, Data2=y_2)
grid = ClusterInput()
level = ClusterInput()
construct_path = ConstructPath(Indices=merge)  # -> flatten(Branch)
grid_2 = Data(simplify(graft(grid)))
level_2 = Integer(graft(level))
B = ClusterInput()
rotate = ClusterInput()
flip = ClusterInput()
tree_branch = TreeBranch(Tree=grid_2, Path=construct_path, MaintainPaths=False)
multiplication = Multiplication(B=B)
rotate_2 = Number(rotate)
flip_2 = Boolean(flip)
cluster = Cluster_4(number=rotate_2, boolean=flip_2)
unit_z = UnitZ(Factor=multiplication)
unit_x = UnitX(Factor=multiplication)
cluster_2 = Cluster_5(boolean=flip_2, plane=tree_branch)  # -> result, transform_3
pi = Pi(Factor=expr("x*0.5", cluster))
move = Move(Geometry=cluster_2.result, Motion=Vector(0, 0, 0))  # -> Geometry, Transform
rotate_3 = Rotate(Angle=pi, Plane=cluster_2.result)  # -> Geometry, Transform
module_plane = Plane(move.Geometry)
merge_2 = Merge(Data1=cluster_2.transform_3, Data2=rotate_3.Transform, Data3=move.Transform)
module_plane_2 = ClusterOutput(module_plane)
compound = Compound(Transforms=merge_2)
transform = Transform(compound)
transform_2 = ClusterOutput(transform)

# ==== cluster Cluster_7
x = ClusterInput()
y = ClusterInput()
x_2 = Integer(graft(x))
y_2 = Integer(graft(y))
level = ClusterInput()
merge = Merge(Data1=x_2, Data2=y_2)
grid = ClusterInput()
level_2 = Integer(graft(level))
number_slider = Slider(50, range=0..100)
construct_path = ConstructPath(Indices=merge)  # -> flatten(Branch)
grid_2 = Data(simplify(graft(grid)))
B = ClusterInput()
rotate = ClusterInput()
flip = ClusterInput()
tree_branch = TreeBranch(Tree=grid_2, Path=construct_path, MaintainPaths=False)
multiplication = Multiplication(B=B)
rotate_2 = Number(rotate)
flip_2 = Boolean(flip)
cluster = Cluster_4(number=rotate_2, boolean=flip_2)
unit_x = UnitX(Factor=multiplication)
unit_z = UnitZ(Factor=multiplication)
cluster_2 = Cluster_5(boolean=flip_2, plane=tree_branch)  # -> result, transform_3
pi = Pi(Factor=expr("x*0.5", cluster))
move = Move(Geometry=cluster_2.result, Motion=Vector(0, 0, 0))  # -> Geometry, Transform
rotate_3 = Rotate(Angle=pi, Plane=cluster_2.result)  # -> Geometry, Transform
module_plane = Plane(move.Geometry)
merge_2 = Merge(Data1=cluster_2.transform_3, Data2=rotate_3.Transform, Data3=move.Transform)
module_plane_2 = ClusterOutput(module_plane)
compound = Compound(Transforms=merge_2)
transform = Transform(compound)
transform_2 = ClusterOutput(transform)

# ==== cluster _2DDRAWING
insulation_width = ClusterInput()
cladding_width = ClusterInput()
core_width = ClusterInput()
int_partition_block_instances = ClusterInput()
block_instance = ClusterInput()
int_partition_block_instances_2 = BlockInstance(int_partition_block_instances)
block_instance_2 = BlockInstance(block_instance)
indoor_module = ClusterInput()
merge = Merge(Data1=block_instance_2, Data2=int_partition_block_instances_2)
explode_object = ExplodeObject(Object=merge, Recursive=True)
equality_filter = EqualityFilter(Value="100_REF::100_DOOR_OPEN_REF")  # -> Equal, Unequal
data = Data(explode_object)
filter_content = FilterContent(Content=data, Filter=equality_filter.Equal)
equality_filter_2 = EqualityFilter(Value="100_REF::100_COLUMN REF")  # -> Equal, Unequal
equality_filter_3 = EqualityFilter(Value="100_REF::100_FLOOR REF")  # -> Equal, Unequal
filter_content_2 = FilterContent(Content=data, Filter=equality_filter_2.Equal)
filter_content_3 = FilterContent(Content=data, Filter=equality_filter_3.Equal)
curve = Curve(flatten(filter_content))
equality_filter_4 = EqualityFilter(Value="100_REF::100_INTERRIOR WALL REF")  # -> Equal, Unequal
curve_2 = Curve(flatten(filter_content_2))
curve_3 = Curve(flatten(filter_content_3))
boundary_surfaces = BoundarySurfaces(Edges=graft(curve))  # -> flatten(Surfaces)
filter_content_4 = FilterContent(Content=data, Filter=equality_filter_4.Equal)  # -> flatten(Content)
region_union = RegionUnion(Curves=curve_3)
core_width_2 = Number(expr("x*0.5", core_width))
core_width_3 = Number(core_width)
equality_filter_5 = EqualityFilter(Value="100_REF::100_VOLUME REF")  # -> Equal, Unequal
number = Number(expr("X*0.5", core_width_3))
curve_4 = Curve(filter_content_4)
offset_curve = OffsetCurve(Curve=region_union, Distance=core_width_2, Corners=1)
indoor_module_2 = Boolean(indoor_module)
extend_curve = ExtendCurve(Curve=curve_4, Type=0, Start=number, End=number)  # -> graft(Curve)
filter_content_5 = FilterContent(Content=data, Filter=equality_filter_5.Equal)
cluster = Cluster_8(brep=boundary_surfaces)
region_union_2 = RegionUnion(Curves=curve_2)  # -> simplify(Result)
floor = Curve(offset_curve)
floor_2 = ClusterOutput(floor)
simplify_curve = SimplifyCurve(Curve=extend_curve)  # -> Curve, Simplified
cluster_2 = Cluster_9(base=cluster)
curve_5 = Curve(flatten(filter_content_5))
boundary_surfaces_2 = BoundarySurfaces(Edges=region_union_2)
cull_pattern = CullPattern(List=curve_5, CullPattern=indoor_module_2)
explode = Explode(Curve=simplify_curve.Curve, Recursive=True)  # -> Segments, Vertices
curve_6 = Curve(graft(explode.Segments))
columns_outline = Brep(boundary_surfaces_2)
region_union_3 = RegionUnion(Curves=cull_pattern)  # -> simplify(Result)
curve_middle = CurveMiddle(Curve=curve_6)
columns = Brep(columns_outline)
data_2 = Data(data)
curve_closest_point = CurveClosestPoint(Point=curve_middle, Curve=flatten(region_union_3))  # -> Point, Parameter, Distance
equality_filter_6 = EqualityFilter(Value="100_REF::100_VOLUME REF")  # -> Equal, Unequal
equality_filter_7 = EqualityFilter(Value="100_REF::100_FACADE OPENNING REF")  # -> Equal, Unequal
smaller_than = SmallerThan(FirstNumber=curve_closest_point.Distance, SecondNumber=Slider(0.01, range=0..0.01))  # -> SmallerThan, OrEqualTo
filter_content_6 = FilterContent(Content=data_2, Filter=equality_filter_7.Equal)
filter_content_7 = FilterContent(Content=data_2, Filter=equality_filter_6.Equal)
cull_pattern_2 = CullPattern(List=curve_6, CullPattern=invert(smaller_than.SmallerThan))  # -> flatten(List)
panel = Panel("""-0.5
0.5""")
core_width_4 = Number(core_width)
curve_7 = Curve(flatten(filter_content_6))
curve_8 = Curve(flatten(filter_content_7))
unit_z = UnitZ(Factor=1)
join_curves = JoinCurves(Curves=cull_pattern_2, Preserve=False)
trim_with_breps = TrimWithBreps(Curve=join_curves, Brep=flatten(cluster_2))  # -> Inside, Outside
multiplication = Multiplication(A=panel, B=core_width_4)
xy_plane = XYPlane(Origin=Point(0, 0, 0))
cull_pattern_3 = CullPattern(List=curve_8, CullPattern=indoor_module_2)
extrude = Extrude(Base=columns, Direction=unit_z)
curve_9 = Curve(flatten(trim_with_breps.Outside))
insulation_width_2 = Number(insulation_width)
core_width_5 = Number(expr("x*0.5", core_width))
move = Move(Geometry=extrude, Motion=expr("-x*0.5", unit_z))  # -> Geometry, Transform
region_union_4 = RegionUnion(Curves=cull_pattern_3)  # -> simplify(Result)
brep = Brep(move.Geometry)
cluster_3 = Cluster_10(curve=curve_7, curve_3=region_union_4)
columns_2 = Brep(brep)
trim_with_breps_2 = TrimWithBreps(Curve=graft(cluster_3), Brep=flatten(columns_2))  # -> Inside, Outside
curve_10 = Curve(trim_with_breps_2.Outside)
core_width_6 = Number(expr("X*0.5", core_width))
shift_paths = ShiftPaths(Data=curve_10, Offset=-2)
offset_curve_2 = OffsetCurve(Curve=shift_paths, Distance=core_width_6, Corners=1)
cluster_4 = Cluster_11(curve_3=region_union_4, curve=shift_paths)
curve_11 = Curve(flatten(cluster_4))
join_curves_2 = JoinCurves(Curves=curve_11, Preserve=True)
offset_curve_3 = OffsetCurve(Curve=offset_curve_2, Distance=insulation_width_2, Plane=PlaneXY(0, 0, 0), Corners=1)
offset_curve_4 = OffsetCurve(Curve=offset_curve_2, Distance=Slider(0.07, range=0..0.1), Plane=PlaneXY(0, 0, 0), Corners=1)
ext_wall_crv = Curve(join_curves_2)
ext_wall_crv_2 = Curve(ext_wall_crv)
merge_2 = Merge(Data1=curve_9, Data2=ext_wall_crv_2)  # -> flatten(Result)
offset_curve_5 = OffsetCurve(Curve=graft(merge_2), Distance=multiplication, Plane=xy_plane, Corners=1)
offset_curve_6 = OffsetCurve(Curve=ext_wall_crv_2, Distance=core_width_5, Plane=PlaneXY(0, 0, 0), Corners=1)
shift_paths_2 = ShiftPaths(Data=offset_curve_5, Offset=-1)
offset_curve_7 = OffsetCurve(Curve=offset_curve_6, Distance=insulation_width_2, Plane=PlaneXY(0, 0, 0), Corners=1)
loft = Loft(Curves=shift_paths_2, Options={Adjust=False, Closed=False, LoftEnds=0, LoftSimp=0, LoftType=0, Rebuild=10, Refit=0.01})
merge_3 = Merge(Data1=simplify(offset_curve_6), Data2=simplify(offset_curve_7))
brep_edges = BrepEdges(Brep=loft)  # -> Naked, Interior, NonManifold
loft_2 = Loft(Curves=merge_3, Options={Adjust=False, Closed=False, LoftEnds=0, LoftSimp=0, LoftType=0, Rebuild=10, Refit=0.01})
curve_12 = Curve(simplify(brep_edges.Naked))
join_curves_3 = JoinCurves(Curves=curve_12, Preserve=False)  # -> simplify(Curves)
boundary_surfaces_3 = BoundarySurfaces(Edges=join_curves_3)
brep_2 = Brep(flatten(boundary_surfaces_3))
cluster_5 = Cluster_8(brep=brep_2)
clean_tree = CleanTree(RemoveNulls=True, RemoveInvalid=True, RemoveEmpty=False, Tree=cluster_5)
merge_4 = Merge(Data1=offset_curve_3, Data2=offset_curve_2, Data3=offset_curve_4)
merge_5 = Merge(Data1=clean_tree, Data2=loft_2)  # -> flatten(Result)
window = Curve(merge_4)
project = Project(Geometry=merge_5, Plane=PlaneXY(0, 0, 0))  # -> Geometry, Transform
window_2 = ClusterOutput(window)
solid_union = SolidUnion(Breps=project.Geometry)
merge_faces = MergeFaces(Brep=solid_union)  # -> Breps, Before, After
curve_13 = Curve(columns)
curve_14 = Curve(merge_faces.Breps)
merge_6 = Merge(Data1=curve_14, Data2=curve_13)  # -> flatten(Result)
xy_plane_2 = XYPlane(Origin=Point(0, 0, 0))
region_union_5 = RegionUnion(Curves=merge_6, Plane=xy_plane_2)
curve_15 = Curve(region_union_5)
curve_16 = ClusterOutput(curve_15)
boundary_surfaces_4 = BoundarySurfaces()

# ==== cluster DIM
geometry = ClusterInput()
geometry_2 = Geometry(geometry)
annotation_text_settings = AnnotationTextSettings(TextGap=Slider(1, range=0..1))  # -> TextSettings, Font, TextHeight, TextGap, Mask, MaskColour, MaskMargins, MaskFrame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
bounding_box = BoundingBox(Content=geometry_2, Plane=PlaneXY(0, 0, 0), UnionBox=True)  # -> Box, Box_2
rectangle = Rectangle(bounding_box.Box)
explode = Explode(Curve=rectangle, Recursive=True)  # -> Segments, Vertices
annotation_arrow_settings = AnnotationArrowSettings(Arrow1=9, Arrow2=9)  # -> ArrowSettings, Arrow1, Arrow2, ArrowSize, FitArrow, DimensionInline, LeaderArrow, LeaderArrowSize
panel = Panel("""0
1""")
list_item = ListItem(List=explode.Segments, Index=panel, Wrap=True)
annotation_style = AnnotationStyle(
    Name="NX_DIM",
    ModelScale=Slider(0.1, range=0..0.1),
    TextSettings=annotation_text_settings.TextSettings,
    ArrowSettings=annotation_arrow_settings.ArrowSettings)  # -> AnnotationStyle, Name, ModelScale, TextSettings, DimensionSettings, ArrowSettings, UnitsSettings, LeaderSettings, ToleranceSettings
offset_curve = OffsetCurve(Curve=list_item, Distance=1, Corners=1)
linear_dimension = LinearDimension(BaseLine=offset_curve, Style=annotation_style.AnnotationStyle)  # -> LinearDimension, BaseLine, PointA, PointB, TextOverride, Style, TextSettings, DimensionSettings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
panel_2 = Panel(linear_dimension.LinearDimension)
model_object = ModelObject(Object=linear_dimension.LinearDimension, Layer="200_ANNO::200_DIM")  # -> Object, Geometry, Name, Layer, Visibility, Display, Drafting, Render
explode_object = ExplodeObject(Object=model_object.Object, Recursive=False)
objects = ClusterOutput(explode_object)
panel_3 = Panel(explode_object)

# ==== cluster Cluster_13
rectangle = ClusterInput()
cluster = Cluster_12(rectangle=rectangle)
A = ClusterInput()
multiplication = Multiplication(A=A, B=cluster)
result = ClusterOutput(multiplication)

# ==== cluster Cluster_4
number = ClusterInput()
boolean = ClusterInput()
number_2 = Number(graft(number))
boolean_2 = Boolean(graft(boolean))
cull_pattern = CullPattern(List=number_2, CullPattern=invert(boolean_2))
cull_pattern_2 = CullPattern(List=number_2, CullPattern=boolean_2)
negative = Negative(Value=cull_pattern)
merge = Merge(Data1=cull_pattern_2, Data2=negative)
result = ClusterOutput(merge)

# ==== cluster Cluster_5
boolean = ClusterInput()
plane = ClusterInput()
boolean_2 = Boolean(graft(boolean))
plane_2 = Plane(plane)
cull_pattern = CullPattern(List=plane_2, CullPattern=invert(boolean_2))
cull_pattern_2 = CullPattern(List=plane_2, CullPattern=boolean_2)
flip = Flip(plane=cull_pattern_2)  # -> plane_4, transform_3
transform = Transform(cull_pattern)
merge = Merge(Data1=flip.transform_3, Data2=transform)
merge_2 = Merge(Data1=flip.plane_4, Data2=cull_pattern)
transform_2 = Transform(merge)
result = ClusterOutput(merge_2)
transform_3 = ClusterOutput(transform_2)

# ==== cluster Cluster_8
brep = ClusterInput()
brep_2 = Brep(brep)
evaluate_surface = EvaluateSurface(Surface=reparameterize(brep_2), Point=Point(0, 0, 0))  # -> Point, Normal, UDirection, VDirection, Frame
unit_z = UnitZ(Factor=1)
dot_product = DotProduct(VectorA=evaluate_surface.Normal, VectorB=unit_z, Unitize=False)
smaller_than = SmallerThan(FirstNumber=dot_product, SecondNumber=Slider(0, range=0..100))  # -> SmallerThan, OrEqualTo
cull_pattern = CullPattern(List=brep_2, CullPattern=invert(smaller_than.SmallerThan))
cull_pattern_2 = CullPattern(List=brep_2, CullPattern=smaller_than.SmallerThan)
flip_polysurface = FlipPolysurface(Polysurface=cull_pattern_2)  # -> Flipped, ResultBoolean
merge = Merge(Data1=flip_polysurface.Flipped, Data2=cull_pattern)
brep_3 = Brep(merge)
brep_4 = ClusterOutput(brep_3)

# ==== cluster Cluster_9
unit_z = UnitZ(Factor=1)
base = ClusterInput()
extrude = Extrude(Base=base, Direction=unit_z)
move = Move(Geometry=extrude, Motion=expr("-X*0.5", unit_z))  # -> Geometry, Transform
geometry = ClusterOutput(move.Geometry)

# ==== cluster Cluster_10
curve = ClusterInput()
curve_2 = Curve(curve)
explode = Explode(Curve=curve_2, Recursive=True)  # -> Segments, Vertices
shift_paths = ShiftPaths(Data=explode.Segments, Offset=-1)
curve_3 = ClusterInput()
curve_4 = Curve(curve_3)
curve_middle = CurveMiddle(Curve=shift_paths)
curve_closest_point = CurveClosestPoint(Point=curve_middle, Curve=curve_4)  # -> Point, Parameter, Distance
evaluate_curve = EvaluateCurve(Curve=curve_4, Parameter=curve_closest_point.Parameter)  # -> Point, Tangent, Angle
smaller_than = SmallerThan(FirstNumber=curve_closest_point.Distance, SecondNumber=Slider(0.01, range=0..0.01))  # -> SmallerThan, OrEqualTo
move = Move(Geometry=evaluate_curve.Point, Motion=evaluate_curve.Tangent)  # -> Geometry, Transform
line = Line(StartPoint=evaluate_curve.Point, EndPoint=move.Geometry)
flip_curve = FlipCurve(Curve=shift_paths, Guide=line)  # -> Curve, Flag
cull_pattern = CullPattern(List=flip_curve.Curve, CullPattern=smaller_than.SmallerThan)
curve_5 = Curve(cull_pattern)
curve_6 = ClusterOutput(curve_5)

# ==== cluster Cluster_11
curve = ClusterInput()
panel = Panel("""-0.5
0.5""")
curve_2 = Curve(graft(curve))
multiplication = Multiplication(A=panel, B=Slider(0.15, range=0..1))
offset_curve = OffsetCurve(Curve=curve_2, Distance=multiplication, Corners=1)
shift_paths = ShiftPaths(Data=offset_curve, Offset=-1)
unit_z = UnitZ(Factor=1)
loft = Loft(Curves=shift_paths, Options={Adjust=False, Closed=False, LoftEnds=0, LoftSimp=0, LoftType=0, Rebuild=10, Refit=0.01})
extrude = Extrude(Base=loft, Direction=unit_z)
move = Move(Geometry=extrude, Motion=expr("-X*0.5", unit_z))  # -> Geometry, Transform
curve_3 = ClusterInput()
curve_4 = Curve(curve_3)
brep = Brep(move.Geometry)
explode = Explode(Curve=curve_4, Recursive=True)  # -> simplify(graft(Segments)), Vertices
trim_with_breps = TrimWithBreps(Curve=explode.Segments, Brep=flatten(brep))  # -> Inside, Outside
longest_list = LongestList(ListListA=trim_with_breps.Outside, ListListB=curve_4, PaddingMode=2)  # -> simplify(ListListA), simplify(ListListB)
flip_curve = FlipCurve(Curve=simplify(longest_list.ListListA), Guide=longest_list.ListListB)  # -> Curve, Flag
curve_5 = Curve(flip_curve.Curve)
curve_6 = ClusterOutput(curve_5)

# ==== cluster Cluster_12
rectangle = ClusterInput()
deconstruct_rectangle = DeconstructRectangle(Rectangle=rectangle)  # -> BasePlane, XInterval, YInterval
deconstruct_domain = DeconstructDomain(Domain=deconstruct_rectangle.YInterval)  # -> Start, End
deconstruct_domain_2 = DeconstructDomain(Domain=deconstruct_rectangle.XInterval)  # -> Start, End
subtraction = Subtraction(A=deconstruct_domain_2.End, B=deconstruct_domain_2.Start)
subtraction_2 = Subtraction(A=deconstruct_domain.End, B=deconstruct_domain.Start)
division = Division(A=subtraction, B=subtraction_2)
result = ClusterOutput(division)

# ==== cluster Flip
plane = ClusterInput()
plane_2 = Plane(plane)
deconstruct_plane = DeconstructPlane(Plane=plane_2)  # -> Origin, XAxis, YAxis, ZAxis
negative = Negative(Value=deconstruct_plane.XAxis)
mirror = Mirror(Plane=plane_2)  # -> Geometry, Transform
construct_plane = ConstructPlane(Origin=deconstruct_plane.Origin, XAxis=negative, YAxis=deconstruct_plane.YAxis)
orient = Orient(Source=PlaneXY(0, 0, 0), Target=construct_plane)  # -> Geometry, Transform
transform = Transform(construct_plane)
merge = Merge(Data1=transform, Data2=mirror.Transform)
compound = Compound(Transforms=merge)
transform_2 = Transform(compound)
transform_3 = ClusterOutput(transform_2)
plane_3 = Plane(construct_plane)
plane_4 = ClusterOutput(plane_3)
