# Grasshopper definition Configurator_Element_Drawings02.gh (Grasshopper 1.0.8)
# plug-ins: GraphicPlus

add_to_sys_path = Script()
# ---------- add_to_sys_path: Python ----------
import sys, os

project_root = r"E:\ARCH\Nexus\Nexus_Mind"            # ← adjust to your folder
src_folder    = os.path.join(project_root, "src")
if src_folder not in sys.path:
    sys.path.insert(0, src_folder)
# ---------- end add_to_sys_path ----------
file_path = FilePath("E:\ARCH\Nexus\Website\Nexus-Website\assets\data\NX_ELEMENT_28_SOLUTION.json")
file_path_2 = FilePath("E:\ARCH\Nexus\Website\Nexus-Website\assets\data\NX_ELEMENT_28_PLOT.json")
level = GetInteger(Slider(1, range=0..3), AtLeast=1, AtMost=1, Maximum=2147483647, Minimum=-2147483648, TreeAccess=False)
plot_json = GetString(file_path_2, AtLeast=1, AtMost=1, TreeAccess=False)
panel = Panel(plot_json)
solution_json = GetString(file_path, AtLeast=1, AtMost=1, TreeAccess=False)
script = Script(x=solution_json)  # -> a; inputs x: String
# ---------- script: Python ----------
with open(x, 'r') as f:
    a = f.read()
# ---------- end script ----------
script_2 = Script(x=plot_json)  # -> a; inputs x: String; same code as script

# ---- group: PLOT
panel_2 = Panel("""S
E
N
W""")
plot = Script(response=script_2)  # -> out, north_angle, building_site_size_X, building_site_size_Y, setback_S, setback_E, setback_N, setback_W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; inputs response: String
# ---------- plot: Python ----------
import json
response = json.loads(response)


north_angle = response["north_angle"]
building_site_size_X = response["building_site_size"][0]
building_site_size_Y = response["building_site_size"][1]
setback_S = response["setbacks"]["S"]
setback_E = response["setbacks"]["E"]
setback_N = response["setbacks"]["N"]
setback_W = response["setbacks"]["W"]
access_S = response["access"]["S"]
access_E = response["access"]["E"]
access_N = response["access"]["N"]
access_W = response["access"]["W"]
# ---------- end plot ----------
text = Text(panel_2)
level_2 = Number(Slider(3, range=0..10))
grid_size = Number("3.75")
merge = Merge(Data1=plot.setback_S, Data2=plot.setback_E, Data3=plot.setback_N, Data4=plot.setback_W)
merge_2 = Merge(Data1=plot.access_S, Data2=plot.access_E, Data3=plot.access_N, Data4=plot.access_W)
north_angle = Number(plot.north_angle)
plot_length = Number(plot.building_site_size_Y)
pedestrian_access = Boolean(merge_2)
plot_width = Number(plot.building_site_size_X)
seatback = Number(merge)
lat = Number("49.450065")
lon = Number("10.967395")
E = Slider(10, range=1.5..20)
S = Slider(15, range=1.5..20)
N = Slider(5, range=1.5..10)
W = Slider(3, range=1.5..10)
merge_3 = Merge(Data1=plot_width, Data2=plot_length)
merge_4 = Merge(Data1=S, Data2=E, Data3=N, Data4=W)
neighbour_distance = Number(merge_4)

# ---- group: ARCH_PARAMS
floor_d = Number(Slider(0.15, range=0..1))
floor_h = Number(Slider(3, range=0..10))
beam_h = Number(Slider(0.5, range=0..1))
insulation_width = Number(Slider(0.155, range=0..1))
cladding_width = Number(Slider(0.625, range=0..1))
core_width = Number(Slider(0.15, range=0..1))
floor_h_2 = Number(floor_h)
floor_d_2 = Number(floor_d)
beam_h_2 = Number(beam_h)

# ----
file_path_3 = FilePath("E:\ARCH\Nexus\Website\Nexus-Website\assets\rhino\NX_ELEMENT_MODULES.3dm")
moules_file_path = GetString(file_path_3, AtLeast=1, AtMost=1, TreeAccess=False)
import_content = ImportContent(FilePath=moules_file_path, Import=True)
plot_length_2 = Number(plot_length)
plot_width_2 = Number(plot_width)
convert_units = ConvertUnits(Data=1, Source=1, Target=4)
cluster = Cluster_3(grid_size=grid_size, plot_width=plot_width, plot_length=plot_length, seatback=seatback)  # -> rectangle_2, plane_2

# ---- group: SUN SETTINGS
north_angle_2 = Number(expr("x+90", north_angle))
lat_2 = Number(lat)
lon_2 = Number(lon)
sun = Sun(Enabled=Toggle(True), Latitude=degrees(lat_2), Longitude=degrees(lon_2), North=degrees(north_angle_2))  # -> Sun, Enabled, Intensity, DateTime, degrees(Latitude), degrees(Longitude), degrees(North)

# ----
number_slider = Slider(1, range=0..1)
equality_filter = EqualityFilter(Value="Curve")  # -> Equal, Unequal
equality_filter_2 = EqualityFilter(Value="Annotation")  # -> Equal, Unequal
contains_text_filter = ContainsTextFilter(Text="200_ANNO::200_MODULE_TAG", Case=True, Culture=127, ContainsTextMode=0)
contains_text_filter_2 = ContainsTextFilter(Text="300_DRAFTING::300_ENT", Case=True, Culture=127, ContainsTextMode=0)
contains_text_filter_3 = ContainsTextFilter(Text="100_REF", Case=True, Culture=127, ContainsTextMode=0)
contains_text_filter_4 = ContainsTextFilter(Text="200_ANNO::200_PART_TAG", Case=True, Culture=127, ContainsTextMode=0)
contains_text_filter_5 = ContainsTextFilter(Text="400_MODEL", Case=True, Culture=127, ContainsTextMode=0)
logical_or_filter = LogicalOrFilter(FilterA=equality_filter.Equal, FilterB=equality_filter_2.Equal)
logical_not_filter = LogicalNotFilter(Filter=contains_text_filter)
logical_not_filter_2 = LogicalNotFilter(Filter=contains_text_filter_3)
logical_not_filter_3 = LogicalNotFilter(Filter=contains_text_filter_2)
logical_not_filter_4 = LogicalNotFilter(Filter=contains_text_filter_4)
logical_not_filter_5 = LogicalNotFilter(Filter=contains_text_filter_5)
logical_and_filter = LogicalAndFilter(FilterA=equality_filter.Equal, FilterB=logical_not_filter_2)
logical_and_filter_2 = LogicalAndFilter(FilterA=logical_and_filter, FilterB=logical_not_filter_3)
logical_and_filter_3 = LogicalAndFilter(FilterA=logical_and_filter_2, FilterB=logical_not_filter_5)
logical_and_filter_4 = LogicalAndFilter(FilterA=logical_not_filter, FilterB=logical_not_filter_4)
logical_and_filter_5 = LogicalAndFilter(FilterA=logical_and_filter_3, FilterB=logical_and_filter_4)
rectangle = Rectangle(Plane=PlaneXY(0, 0, 0), XSize=Domain(-1, 1), YSize=Domain(-2, 2), Radius=0)  # -> Rectangle, Length
range = Range(Domain=Domain(0, 1), Steps=10)
circle = Circle(Plane=PlaneXY(0, 0, 0), Radius=range)
number_slider_2 = Slider(1, range=0..1)

level_3 = Integer(level)
unpack_partitions = Script(level=level_3, response=script)  # -> out, type_id, x, y, rotation, flip; inputs level: Int32
# ---------- unpack_partitions: Python ----------
import json

result = json.loads(response)

name = []
type_id = []
x = []
y = []

rotation = []
flip = []
for partition in result["house"]["partitions"]:
    l = partition['level']
    if l == level:
        type_id.append(partition["type"])
        x.append(partition['cell'][0])
        y.append(partition['cell'][1])
        rotation.append(partition["rotation"])
        flip.append(partition["flip"])
# ---------- end unpack_partitions ----------
unpack_modules = Script(level=level_3, response=script)  # -> out, name, type_id, x, y, rotation, flip, is_indoor; inputs level: Int32
# ---------- unpack_modules: Python ----------
import json

result = json.loads(response)
grid_shape = result['house']['grid_shape']
num_levels = grid_shape[2]

name = []
type_id = []
x = []
y = []
rotation = []
flip = []
is_indoor = []
for module in result['house']['modules']:
    l = module['position'][2]
    if l == level:
        name.append(module['name'])
        t = module['type']

        if t == "NX_ELE_STA_00":
            if l>0 and l<num_levels-1:
                t = "NX_ELE_STA_02"
            elif l == num_levels - 1:
                t = "NX_ELE_STA_01"

        type_id.append(t)
        x.append(module['position'][0])
        y.append(module['position'][1])
        rotation.append(module['rotation'])
        flip.append(module['flip'])
        is_indoor.append(module['is_indoor'])
# ---------- end unpack_modules ----------

equality_filter_3 = EqualityFilter(Value=unpack_modules.type_id)  # -> Equal, Unequal
equality_filter_4 = EqualityFilter(Value=unpack_partitions.type_id)  # -> Equal, Unequal
filter_content = FilterContent(Content=import_content, Filter=equality_filter_4.Equal)  # -> flatten(Content)
filter_content_2 = FilterContent(Content=import_content, Filter=equality_filter_3.Equal)  # -> flatten(Content)
model_block_definition = ModelBlockDefinition(filter_content_2)
model_block_definition_2 = ModelBlockDefinition(filter_content)
boolean = Boolean(unpack_modules.is_indoor)

construct_domain = ConstructDomain(DomainStart=0, DomainEnd=plot_width_2)
construct_domain_2 = ConstructDomain(DomainStart=0, DomainEnd=plot_length_2)
rectangle_2 = Rectangle(Plane=PlaneXY(0, 0, 0), XSize=construct_domain, YSize=construct_domain_2, Radius=0)  # -> Rectangle, Length
area = Area(Geometry=rectangle_2.Rectangle)  # -> Area, Centroid
point = Point(area.Centroid)

geometry = Geometry(rectangle_2.Rectangle)
plot_area = Panel(area.Area)
vector = Vector(expr("-X", point))

seatback_2 = Number(seatback)
list_item = ListItem(List=seatback_2, Index=0, Wrap=True)  # -> Item, Item1, Item2, Item3
addition = Addition(B=list_item.Item)
subtraction = Subtraction(A=plot_length_2, B=list_item.Item2)
addition_2 = Addition(B=list_item.Item3)
subtraction_2 = Subtraction(A=plot_width_2, B=list_item.Item1)
construct_domain_3 = ConstructDomain(DomainStart=addition_2, DomainEnd=subtraction_2)
construct_domain_4 = ConstructDomain(DomainStart=addition, DomainEnd=subtraction)
rectangle_3 = Rectangle(Plane=PlaneXY(0, 0, 0), XSize=construct_domain_3, YSize=construct_domain_4, Radius=0)  # -> Rectangle, Length
move = Move(Geometry=rectangle_3.Rectangle, Motion=vector)  # -> Geometry, Transform

move_2 = Move(Geometry=geometry, Motion=vector)  # -> Geometry, Transform

cluster_2 = Cluster_2(geometry=move_2.Geometry)  # -> polyline_3, polyline_4
merge_5 = Merge(Data1=move_2.Geometry, Data2=move.Geometry)
cluster_3 = Cluster(curve_a=cluster_2.polyline_3, curve_b=merge_5)
cluster_4 = Cluster(curve_a=cluster_2.polyline_4, curve_b=merge_5)
drafting_attributes = DraftingAttributes(DrawOrder=Slider(10, range=0..10))
merge_6 = Merge(Data1=cluster_3, Data2=cluster_4)

move_3 = Move(Geometry=cluster.rectangle_2, Motion=vector)  # -> Geometry, Transform
move_4 = Move(Geometry=cluster.plane_2, Motion=vector)  # -> Geometry, Transform

cluster_5 = Cluster_7(
    level=level_3,
    grid=move_4.Geometry,
    x=unpack_partitions.x,
    y=unpack_partitions.y,
    B=level_2,
    rotate=unpack_partitions.rotation,
    flip=unpack_partitions.flip)  # -> module_plane_2, simplify(transform_2)
cluster_6 = Cluster_6(
    level=level_3,
    grid=move_4.Geometry,
    x=unpack_modules.x,
    y=unpack_modules.y,
    B=level_2,
    rotate=unpack_modules.rotation,
    flip=unpack_modules.flip)  # -> module_plane_2, transform_2

model_block_instance = ModelBlockInstance(Transform=cluster_6.transform_2, BlockDefinition=graft(model_block_definition))  # -> flatten(BlockInstance), flatten(Transform)
model_block_instance_2 = ModelBlockInstance(Transform=cluster_5.transform_2, BlockDefinition=graft(model_block_definition_2))  # -> flatten(BlockInstance), flatten(Transform)
scale = Scale(Geometry=model_block_instance_2.BlockInstance, Center=model_block_instance_2.Transform, Factor=convert_units)  # -> Geometry, Transform
scale_2 = Scale(Geometry=model_block_instance.BlockInstance, Center=model_block_instance.Transform, Factor=convert_units)  # -> Geometry, Transform
curve = Curve(flatten(move_3.Geometry))
explode = Explode(Curve=graft(curve), Recursive=True)  # -> simplify(Segments), Vertices

control_points = ControlPoints(Curve=move_2.Geometry)  # -> Points, Weights, Knots
script_3 = Script(x=control_points.Points)  # -> a; inputs x: list
# ---------- script_3: Python ----------
a = x[:-1]
# ---------- end script_3 ----------

point_2 = Point(flatten(explode.Vertices))
line = Line(explode.Segments)
flip_matrix = FlipMatrix(Data=line)
removeduplicatepts = RemoveDuplicatePts(Points=point_2, Tolerance=0.01)
join_curves = JoinCurves(Curves=flip_matrix, Preserve=False)  # -> simplify(flatten(Curves))
circle_2 = Circle(Plane=removeduplicatepts, Radius=Slider(0.05, range=0..0.1))
line_2 = Line(join_curves)
curve_2 = Curve(circle_2)
removeduplicatelines = RemoveDuplicateLines(Lines=line_2, Tolerance=0.01)
extend_curve = ExtendCurve(Curve=removeduplicatelines, Type=0, Start=number_slider, End=number_slider)
model_object = ModelObject(Geometry=extend_curve, Layer="200_ANNO::200_GRID")  # -> Object, Geometry, Name, Layer, Visibility, Display, Drafting, Render
model_object_2 = ModelObject(Geometry=curve_2, Layer="200_ANNO::200_MODULE_MARKERS")  # -> Object, Geometry, Name, Layer, Visibility, Display, Drafting, Render
_2d_drawing = _2DDRAWING(
    block_instance=scale_2.Geometry,
    int_partition_block_instances=scale.Geometry,
    core_width=core_width,
    insulation_width=insulation_width,
    cladding_width=cladding_width,
    indoor_module=boolean)  # -> flatten(brep_4), flatten(curve_15), flatten(window_2)
join_curves_2 = JoinCurves(Curves=_2d_drawing.curve_15, Preserve=False)  # -> flatten(Curves)
cluster_7 = Cluster_12(geometry=join_curves_2)  # disabled
model_object_3 = ModelObject(Geometry=join_curves_2, Layer="300_DRAFTING::300_WALL_CUT")
explode_object = ExplodeObject(Object=scale_2.Geometry, Recursive=True)
explode_object_2 = ExplodeObject(Object=scale.Geometry, Recursive=True)
model_object_4 = ModelObject(Geometry=_2d_drawing.window_2, Layer="300_DRAFTING::300_WALL_ELE")
merge_7 = Merge(Data7=flatten(cluster_7), Data8=model_object.Object)  # -> flatten(Result)
model_object_5 = ModelObject(merge_7)
script_4 = Script(x=model_object_5)  # -> out, a
# ---------- script_4: Python ----------
print(x.ObjectType)
# ---------- end script_4 ----------
panel_3 = Panel(script_4.out)
filter_content_3 = FilterContent(Content=model_object_5, Filter=logical_and_filter_5)
clean_tree = CleanTree(RemoveNulls=True, RemoveInvalid=True, RemoveEmpty=True, Tree=filter_content_3)
model_object_6 = ModelObject(Object=clean_tree)  # -> Object, flatten(Geometry), Name, Layer, Visibility, Display, Drafting, Render
content_identity = ContentIdentity(Content=model_object_6.Layer)  # -> Content, Id, Path
clean_tree_2 = CleanTree(RemoveNulls=True, RemoveInvalid=True, RemoveEmpty=True, Tree=model_object_6.Geometry)
length = Length(Curve=model_object_6.Geometry)
smaller_than = SmallerThan(FirstNumber=length, SecondNumber=Slider(2, range=0..10))  # -> SmallerThan, OrEqualTo
svg_text = SVGText(DrawingsShapesGeometry=clean_tree_2)
cull_pattern = CullPattern(List=model_object_6.Geometry, CullPattern=invert(smaller_than.SmallerThan))
text_2 = Text(svg_text)
panel_4 = Panel(svg_text)
svg_text_2 = ContextPrint(Text=text_2)

# ==== cluster Cluster
curve_a = ClusterInput()
curve_b = ClusterInput()
curve_curve = CurveCurve(CurveA=curve_a, CurveB=curve_b)  # -> Points, ParamsA, ParamsB
create_set = CreateSet(List=flatten(curve_curve.ParamsA))  # -> Set, Map
list_item = ListItem(List=flatten(curve_curve.Points), Index=create_set.Map, Wrap=True)
sort_list = SortList(Keys=create_set.Set, ValuesValuesA=list_item)  # -> Keys, reverse(ValuesValuesA)
script = Script(x=sort_list.ValuesValuesA)  # -> out, a; inputs x: list
# ---------- script: Python ----------
a = [x[0], x[-1]]
# ---------- end script ----------
shift_list = ShiftList(List=sort_list.ValuesValuesA, Shift=1, Wrap=False)
shift_list_2 = ShiftList(List=script.a, Shift=1, Wrap=False)
shortest_list = ShortestList(ListListA=sort_list.ValuesValuesA, ListListB=shift_list, TrimMode=2)  # -> ListListA, ListListB
shortest_list_2 = ShortestList(ListListA=script.a, ListListB=shift_list_2, TrimMode=2)  # -> ListListA, ListListB
xy_plane = XYPlane(Origin=Point(0, 0, 0))
xy_plane_2 = XYPlane(Origin=Point(0, 0, 0))
aligned_dimension = AlignedDimension(
    Plane=xy_plane,
    PointA=shortest_list.ListListA,
    PointB=shortest_list.ListListB,
    Offset=Slider(1, range=0..10),
    Style=<geometry referenced from the Rhino model>)  # -> AlignedDimension, Plane, PointA, PointB, Offset, Style
aligned_dimension_2 = AlignedDimension(
    Plane=xy_plane_2,
    PointA=shortest_list_2.ListListA,
    PointB=shortest_list_2.ListListB,
    Offset=Slider(1.7, range=0..10),
    Style=<geometry referenced from the Rhino model>)  # -> AlignedDimension, Plane, PointA, PointB, Offset, Style
merge = Merge(Data1=aligned_dimension.AlignedDimension, Data2=aligned_dimension_2.AlignedDimension)
result = ClusterOutput(merge)

# ==== cluster Cluster_2
geometry = ClusterInput()
bounding_rectangle = BoundingRectangle(Geometry=geometry, Plane=PlaneXY(0, 0, 0), Axis=0, Slide=0, Union=True)  # -> Bounding, DimensionX, DimensionY
number_slider = Slider(0, range=0..100)
panel = Panel("""0.3
0.3""")
panel_2 = Panel("""0
1""")
panel_3 = Panel("""0.6
0.6""")
panel_4 = Panel("""0
1""")
evaluate_box = EvaluateBox(Box=bounding_rectangle.Bounding, UParameter=panel_2, VParameter=panel, WParameter=number_slider)  # -> Plane, Point, Include
evaluate_box_2 = EvaluateBox(Box=bounding_rectangle.Bounding, UParameter=panel_3, VParameter=panel_4, WParameter=number_slider)  # -> Plane, Point, Include
polyline = PolyLine(Vertices=evaluate_box_2.Point, Closed=False)
polyline_2 = PolyLine(Vertices=evaluate_box.Point, Closed=False)
polyline_3 = ClusterOutput(polyline)
polyline_4 = ClusterOutput(polyline_2)

# ==== cluster Cluster_3
plot_length = ClusterInput()
seatback = ClusterInput()
plot_width = ClusterInput()
grid_size = ClusterInput()
plot_length_2 = Number(plot_length)
seatback_2 = Number(seatback)
plot_width_2 = Number(plot_width)
grid_size_2 = Number(grid_size)
list_item = ListItem(List=seatback_2, Index=0, Wrap=True)  # -> Item, Item1, Item2, Item3
subtraction = Subtraction(A=plot_width_2, B=list_item.Item1, C=list_item.Item3)
subtraction_2 = Subtraction(A=plot_length_2, B=list_item.Item, C=list_item.Item2)
division = Division(A=subtraction, B=grid_size_2)
division_2 = Division(A=subtraction_2, B=grid_size_2)
round = Round(Number=division)  # -> Nearest, Floor, Ceiling
round_2 = Round(Number=division_2)  # -> Nearest, Floor, Ceiling
number = Number(expr("X*0.5", grid_size_2))
col = Integer(round.Floor)
row = Integer(round_2.Floor)
number_2 = Number(expr("X*0.5", subtraction))
number_3 = Number(expr("X*0.5", subtraction_2))
addition = Addition(A=number_2, B=list_item.Item1)
addition_2 = Addition(A=number_3, B=list_item.Item)
multiplication = Multiplication(A=col, B=grid_size_2)
multiplication_2 = Multiplication(A=row, B=grid_size_2)
series = Series(Start=number, Step=grid_size_2, Count=row)  # -> reverse(Series)
series_2 = Series(Start=number, Step=grid_size_2, Count=col)
number_4 = Number(expr("X*0.5", multiplication))
number_5 = Number(expr("X*0.5", multiplication_2))
subtraction_3 = Subtraction(A=addition, B=number_4)
subtraction_4 = Subtraction(A=addition_2, B=number_5)
construct_point = ConstructPoint(XCoordinate=series_2, YCoordinate=graft(series), ZCoordinate=0)
construct_point_2 = ConstructPoint(XCoordinate=subtraction_3, YCoordinate=subtraction_4, ZCoordinate=0)
move = Move(Geometry=construct_point, Motion=construct_point_2)  # -> Geometry, Transform
number_6 = Number(number)
construct_domain = ConstructDomain(DomainStart=expr("-X", number_6), DomainEnd=number_6)
xy_plane = XYPlane(Origin=move.Geometry)
rectangle = Rectangle(Plane=xy_plane, XSize=construct_domain, YSize=construct_domain, Radius=0)  # -> Rectangle, Length
plane = Plane(xy_plane)
plane_2 = ClusterOutput(plane)
rectangle_2 = ClusterOutput(rectangle.Rectangle)

# ==== cluster Cluster_6
x = ClusterInput()
y = ClusterInput()
x_2 = Integer(graft(x))
y_2 = Integer(graft(y))
merge = Merge(Data1=x_2, Data2=y_2)
grid = ClusterInput()
level = ClusterInput()
construct_path = ConstructPath(Indices=merge)  # -> flatten(Branch)
grid_2 = Data(simplify(graft(grid)))
level_2 = Integer(graft(level))
B = ClusterInput()
rotate = ClusterInput()
flip = ClusterInput()
tree_branch = TreeBranch(Tree=grid_2, Path=construct_path, MaintainPaths=False)
multiplication = Multiplication(B=B)
rotate_2 = Number(rotate)
flip_2 = Boolean(flip)
cluster = Cluster_4(number=rotate_2, boolean=flip_2)
unit_z = UnitZ(Factor=multiplication)
unit_x = UnitX(Factor=multiplication)
cluster_2 = Cluster_5(boolean=flip_2, plane=tree_branch)  # -> result, transform_3
pi = Pi(Factor=expr("x*0.5", cluster))
move = Move(Geometry=cluster_2.result, Motion=Vector(0, 0, 0))  # -> Geometry, Transform
rotate_3 = Rotate(Angle=pi, Plane=cluster_2.result)  # -> Geometry, Transform
module_plane = Plane(move.Geometry)
merge_2 = Merge(Data1=cluster_2.transform_3, Data2=rotate_3.Transform, Data3=move.Transform)
module_plane_2 = ClusterOutput(module_plane)
compound = Compound(Transforms=merge_2)
transform = Transform(compound)
transform_2 = ClusterOutput(transform)

# ==== cluster Cluster_7
x = ClusterInput()
y = ClusterInput()
x_2 = Integer(graft(x))
y_2 = Integer(graft(y))
level = ClusterInput()
merge = Merge(Data1=x_2, Data2=y_2)
grid = ClusterInput()
level_2 = Integer(graft(level))
number_slider = Slider(50, range=0..100)
construct_path = ConstructPath(Indices=merge)  # -> flatten(Branch)
grid_2 = Data(simplify(graft(grid)))
B = ClusterInput()
rotate = ClusterInput()
flip = ClusterInput()
tree_branch = TreeBranch(Tree=grid_2, Path=construct_path, MaintainPaths=False)
multiplication = Multiplication(B=B)
rotate_2 = Number(rotate)
flip_2 = Boolean(flip)
cluster = Cluster_4(number=rotate_2, boolean=flip_2)
unit_x = UnitX(Factor=multiplication)
unit_z = UnitZ(Factor=multiplication)
cluster_2 = Cluster_5(boolean=flip_2, plane=tree_branch)  # -> result, transform_3
pi = Pi(Factor=expr("x*0.5", cluster))
move = Move(Geometry=cluster_2.result, Motion=Vector(0, 0, 0))  # -> Geometry, Transform
rotate_3 = Rotate(Angle=pi, Plane=cluster_2.result)  # -> Geometry, Transform
module_plane = Plane(move.Geometry)
merge_2 = Merge(Data1=cluster_2.transform_3, Data2=rotate_3.Transform, Data3=move.Transform)
module_plane_2 = ClusterOutput(module_plane)
compound = Compound(Transforms=merge_2)
transform = Transform(compound)
transform_2 = ClusterOutput(transform)

# ==== cluster _2DDRAWING
insulation_width = ClusterInput()
cladding_width = ClusterInput()
core_width = ClusterInput()
int_partition_block_instances = ClusterInput()
block_instance = ClusterInput()
int_partition_block_instances_2 = BlockInstance(int_partition_block_instances)
block_instance_2 = BlockInstance(block_instance)
indoor_module = ClusterInput()
merge = Merge(Data1=block_instance_2, Data2=int_partition_block_instances_2)
explode_object = ExplodeObject(Object=merge, Recursive=True)
block_instance_3 = BlockInstance(block_instance_2)
equality_filter = EqualityFilter(Value="100_REF::100_DOOR_OPEN_REF")  # -> Equal, Unequal
data = Data(explode_object)
explode_object_2 = ExplodeObject(Object=block_instance_3, Recursive=True)
filter_content = FilterContent(Content=data, Filter=equality_filter.Equal)
equality_filter_2 = EqualityFilter(Value="100_REF::100_COLUMN REF")  # -> Equal, Unequal
data_2 = Data(explode_object_2)
filter_content_2 = FilterContent(Content=data_2, Filter=equality_filter_2.Equal)
curve = Curve(flatten(filter_content))
data_3 = Data(data)
curve_2 = Curve(flatten(filter_content_2))
boundary_surfaces = BoundarySurfaces(Edges=graft(curve))  # -> flatten(Surfaces)
indoor_module_2 = Boolean(indoor_module)
equality_filter_3 = EqualityFilter(Value="100_REF::100_VOLUME REF")  # -> Equal, Unequal
filter_content_3 = FilterContent(Content=data, Filter=equality_filter_3.Equal)
cluster = Cluster_8(brep=boundary_surfaces)
region_union = RegionUnion(Curves=curve_2)  # -> simplify(Result)
cluster_2 = Cluster_9(base=cluster)
curve_3 = Curve(flatten(filter_content_3))
boundary_surfaces_2 = BoundarySurfaces(Edges=region_union)
equality_filter_4 = EqualityFilter(Value="100_REF::100_INTERRIOR WALL REF")  # -> Equal, Unequal
cull_pattern = CullPattern(List=curve_3, CullPattern=indoor_module_2)
filter_content_4 = FilterContent(Content=data, Filter=equality_filter_4.Equal)  # -> flatten(Content)
core_width_2 = Number(core_width)
region_union_2 = RegionUnion(Curves=cull_pattern)  # -> simplify(Result)
columns_outline = Brep(boundary_surfaces_2)
number = Number(expr("X*0.5", core_width_2))
curve_4 = Curve(filter_content_4)
extend_curve = ExtendCurve(Curve=curve_4, Type=0, Start=number, End=number)  # -> graft(Curve)
explode = Explode(Curve=extend_curve, Recursive=True)  # -> Segments, Vertices
curve_5 = Curve(graft(explode.Segments))
curve_middle = CurveMiddle(Curve=curve_5)
columns = Brep(columns_outline)
curve_closest_point = CurveClosestPoint(Point=curve_middle, Curve=flatten(region_union_2))  # -> Point, Parameter, Distance
equality_filter_5 = EqualityFilter(Value="100_REF::100_FACADE OPENNING REF")  # -> Equal, Unequal
equality_filter_6 = EqualityFilter(Value="100_REF::100_VOLUME REF")  # -> Equal, Unequal
smaller_than = SmallerThan(FirstNumber=curve_closest_point.Distance, SecondNumber=Slider(0.01, range=0..0.01))  # -> SmallerThan, OrEqualTo
filter_content_5 = FilterContent(Content=data_3, Filter=equality_filter_5.Equal)
filter_content_6 = FilterContent(Content=data_3, Filter=equality_filter_6.Equal)
panel = Panel("""-0.5
0.5""")
cull_pattern_2 = CullPattern(List=curve_5, CullPattern=invert(smaller_than.SmallerThan))  # -> flatten(List)
core_width_3 = Number(core_width)
curve_6 = Curve(flatten(filter_content_5))
curve_7 = Curve(flatten(filter_content_6))
unit_z = UnitZ(Factor=1)
join_curves = JoinCurves(Curves=cull_pattern_2, Preserve=False)
trim_with_breps = TrimWithBreps(Curve=join_curves, Brep=flatten(cluster_2))  # -> Inside, Outside
multiplication = Multiplication(A=panel, B=core_width_3)
xy_plane = XYPlane(Origin=Point(0, 0, 0))
curve_8 = Curve(flatten(trim_with_breps.Outside))
cull_pattern_3 = CullPattern(List=curve_7, CullPattern=indoor_module_2)
extrude = Extrude(Base=columns, Direction=unit_z)
panel_2 = Panel("""-0.5
0.5""")
insulation_width_2 = Number(insulation_width)
xy_plane_2 = XYPlane(Origin=Point(0, 0, 0))
core_width_4 = Number(expr("x*0.5", core_width))
move = Move(Geometry=extrude, Motion=expr("-x*0.5", unit_z))  # -> Geometry, Transform
core_width_5 = Number(expr("x*0.5", core_width))
multiplication_2 = Multiplication(B=core_width_4)
region_union_3 = RegionUnion(Curves=cull_pattern_3)  # -> simplify(Result)
brep = Brep(move.Geometry)
columns_2 = Brep(brep)
cluster_3 = Cluster_10(curve=curve_6, curve_3=region_union_3)
trim_with_breps_2 = TrimWithBreps(Curve=graft(cluster_3), Brep=flatten(columns_2))  # -> Inside, Outside
curve_9 = Curve(trim_with_breps_2.Outside)
core_width_6 = Number(expr("X*0.5", core_width))
shift_paths = ShiftPaths(Data=curve_9, Offset=-2)
cluster_4 = Cluster_11(curve_3=region_union_3, curve=shift_paths)
curve_10 = Curve(flatten(cluster_4))
offset_curve = OffsetCurve(Curve=shift_paths, Distance=core_width_6, Corners=1)
join_curves_2 = JoinCurves(Curves=curve_10, Preserve=True)
offset_curve_2 = OffsetCurve(Curve=offset_curve, Distance=insulation_width_2, Plane=xy_plane_2, Corners=1)
offset_curve_3 = OffsetCurve(Curve=offset_curve, Distance=Slider(0.07, range=0..0.1), Plane=xy_plane_2, Corners=1)
ext_wall_crv = Curve(join_curves_2)
ext_wall_crv_2 = Curve(ext_wall_crv)
merge_2 = Merge(Data1=curve_8, Data2=ext_wall_crv_2)  # -> flatten(Result)
offset_curve_4 = OffsetCurve(Curve=graft(merge_2), Distance=multiplication, Plane=xy_plane, Corners=1)
offset_curve_5 = OffsetCurve(Curve=ext_wall_crv_2, Distance=core_width_5, Plane=xy_plane_2, Corners=1)
offset_curve_6 = OffsetCurve(Curve=ext_wall_crv_2, Distance=core_width_5, Plane=xy_plane_2, Corners=1)
offset_curve_7 = OffsetCurve(Curve=offset_curve_5, Distance=insulation_width_2, Plane=xy_plane_2, Corners=1)
shift_paths_2 = ShiftPaths(Data=offset_curve_4, Offset=-1)
loft = Loft(Curves=shift_paths_2, Options={Adjust=False, Closed=False, LoftEnds=0, LoftSimp=0, LoftType=0, Rebuild=10, Refit=0.01})
merge_3 = Merge(Data1=simplify(offset_curve_5), Data2=simplify(offset_curve_7))
brep_edges = BrepEdges(Brep=loft)  # -> Naked, Interior, NonManifold
loft_2 = Loft(Curves=merge_3, Options={Adjust=False, Closed=False, LoftEnds=0, LoftSimp=0, LoftType=0, Rebuild=10, Refit=0.01})
curve_11 = Curve(simplify(brep_edges.Naked))
join_curves_3 = JoinCurves(Curves=curve_11, Preserve=False)  # -> simplify(Curves)
boundary_surfaces_3 = BoundarySurfaces(Edges=join_curves_3)
brep_2 = Brep(flatten(boundary_surfaces_3))
merge_4 = Merge(Data1=offset_curve_2, Data2=offset_curve, Data3=offset_curve_3)
cluster_5 = Cluster_8(brep=brep_2)
window = Curve(merge_4)
clean_tree = CleanTree(RemoveNulls=True, RemoveInvalid=True, RemoveEmpty=False, Tree=cluster_5)
window_2 = ClusterOutput(window)
merge_5 = Merge(Data1=clean_tree, Data2=loft_2)  # -> flatten(Result)
project = Project(Geometry=merge_5, Plane=PlaneXY(0, 0, 0))  # -> Geometry, Transform
solid_union = SolidUnion(Breps=project.Geometry)
merge_faces = MergeFaces(Brep=solid_union)  # -> Breps, Before, After
curve_12 = Curve(merge_faces.Breps)
curve_13 = Curve(columns)
merge_6 = Merge(Data1=curve_12, Data2=curve_13)  # -> flatten(Result)
merge_7 = Merge(Data1=merge_faces.Breps, Data2=columns)
xy_plane_3 = XYPlane(Origin=Point(0, 0, 0))
solid_union_2 = SolidUnion(Breps=flatten(merge_7))
region_union_4 = RegionUnion(Curves=merge_6, Plane=xy_plane_3)
brep_3 = Brep(solid_union_2)
curve_14 = Curve(region_union_4)
brep_4 = ClusterOutput(brep_3)
curve_15 = ClusterOutput(curve_14)
boundary_surfaces_4 = BoundarySurfaces()

# ==== cluster Cluster_12
geometry = ClusterInput()
geometry_2 = Geometry(geometry)
bounding_box = BoundingBox(Content=geometry_2, Plane=PlaneXY(0, 0, 0), UnionBox=True)  # -> Box, Box_2
rectangle = Rectangle(bounding_box.Box)
explode = Explode(Curve=rectangle, Recursive=True)  # -> Segments, Vertices
annotation_arrow_settings = AnnotationArrowSettings(Arrow1=3, Arrow2=3)  # -> ArrowSettings, Arrow1, Arrow2, ArrowSize, FitArrow, DimensionInline, LeaderArrow, LeaderArrowSize
number_slider = Slider(0.01, range=0..0.01)
panel = Panel("""0
1""")
list_item = ListItem(List=explode.Segments, Index=panel, Wrap=True)
annotation_style = AnnotationStyle(Name="NX_DIM", ModelScale=Slider(0.1, range=0..0.1), ArrowSettings=annotation_arrow_settings.ArrowSettings)  # -> AnnotationStyle, Name, ModelScale, TextSettings, DimensionSettings, ArrowSettings, UnitsSettings, LeaderSettings, ToleranceSettings
offset_curve = OffsetCurve(Curve=list_item, Distance=1, Corners=1)
linear_dimension = LinearDimension(BaseLine=offset_curve, Style=annotation_style.AnnotationStyle)  # -> LinearDimension, BaseLine, PointA, PointB, TextOverride, Style, TextSettings, DimensionSettings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
panel_2 = Panel(linear_dimension.LinearDimension)
explode_object = ExplodeObject(Object=linear_dimension.LinearDimension, Recursive=False)
objects = ClusterOutput(explode_object)
panel_3 = Panel(explode_object)

# ==== cluster Cluster_4
number = ClusterInput()
boolean = ClusterInput()
number_2 = Number(graft(number))
boolean_2 = Boolean(graft(boolean))
cull_pattern = CullPattern(List=number_2, CullPattern=invert(boolean_2))
cull_pattern_2 = CullPattern(List=number_2, CullPattern=boolean_2)
negative = Negative(Value=cull_pattern)
merge = Merge(Data1=cull_pattern_2, Data2=negative)
result = ClusterOutput(merge)

# ==== cluster Cluster_5
boolean = ClusterInput()
plane = ClusterInput()
boolean_2 = Boolean(graft(boolean))
plane_2 = Plane(plane)
cull_pattern = CullPattern(List=plane_2, CullPattern=invert(boolean_2))
cull_pattern_2 = CullPattern(List=plane_2, CullPattern=boolean_2)
flip = Flip(plane=cull_pattern_2)  # -> plane_4, transform_3
transform = Transform(cull_pattern)
merge = Merge(Data1=flip.transform_3, Data2=transform)
merge_2 = Merge(Data1=flip.plane_4, Data2=cull_pattern)
transform_2 = Transform(merge)
result = ClusterOutput(merge_2)
transform_3 = ClusterOutput(transform_2)

# ==== cluster Cluster_8
brep = ClusterInput()
brep_2 = Brep(brep)
evaluate_surface = EvaluateSurface(Surface=reparameterize(brep_2), Point=Point(0, 0, 0))  # -> Point, Normal, UDirection, VDirection, Frame
unit_z = UnitZ(Factor=1)
dot_product = DotProduct(VectorA=evaluate_surface.Normal, VectorB=unit_z, Unitize=False)
smaller_than = SmallerThan(FirstNumber=dot_product, SecondNumber=Slider(0, range=0..100))  # -> SmallerThan, OrEqualTo
cull_pattern = CullPattern(List=brep_2, CullPattern=invert(smaller_than.SmallerThan))
cull_pattern_2 = CullPattern(List=brep_2, CullPattern=smaller_than.SmallerThan)
flip_polysurface = FlipPolysurface(Polysurface=cull_pattern_2)  # -> Flipped, ResultBoolean
merge = Merge(Data1=flip_polysurface.Flipped, Data2=cull_pattern)
brep_3 = Brep(merge)
brep_4 = ClusterOutput(brep_3)

# ==== cluster Cluster_9
unit_z = UnitZ(Factor=1)
base = ClusterInput()
extrude = Extrude(Base=base, Direction=unit_z)
move = Move(Geometry=extrude, Motion=expr("-X*0.5", unit_z))  # -> Geometry, Transform
geometry = ClusterOutput(move.Geometry)

# ==== cluster Cluster_10
curve = ClusterInput()
curve_2 = Curve(curve)
explode = Explode(Curve=curve_2, Recursive=True)  # -> Segments, Vertices
shift_paths = ShiftPaths(Data=explode.Segments, Offset=-1)
curve_3 = ClusterInput()
curve_4 = Curve(curve_3)
curve_middle = CurveMiddle(Curve=shift_paths)
curve_closest_point = CurveClosestPoint(Point=curve_middle, Curve=curve_4)  # -> Point, Parameter, Distance
evaluate_curve = EvaluateCurve(Curve=curve_4, Parameter=curve_closest_point.Parameter)  # -> Point, Tangent, Angle
smaller_than = SmallerThan(FirstNumber=curve_closest_point.Distance, SecondNumber=Slider(0.01, range=0..0.01))  # -> SmallerThan, OrEqualTo
move = Move(Geometry=evaluate_curve.Point, Motion=evaluate_curve.Tangent)  # -> Geometry, Transform
line = Line(StartPoint=evaluate_curve.Point, EndPoint=move.Geometry)
flip_curve = FlipCurve(Curve=shift_paths, Guide=line)  # -> Curve, Flag
cull_pattern = CullPattern(List=flip_curve.Curve, CullPattern=smaller_than.SmallerThan)
curve_5 = Curve(cull_pattern)
curve_6 = ClusterOutput(curve_5)

# ==== cluster Cluster_11
curve = ClusterInput()
panel = Panel("""-0.5
0.5""")
curve_2 = Curve(graft(curve))
multiplication = Multiplication(A=panel, B=Slider(0.15, range=0..1))
offset_curve = OffsetCurve(Curve=curve_2, Distance=multiplication, Corners=1)
shift_paths = ShiftPaths(Data=offset_curve, Offset=-1)
unit_z = UnitZ(Factor=1)
loft = Loft(Curves=shift_paths, Options={Adjust=False, Closed=False, LoftEnds=0, LoftSimp=0, LoftType=0, Rebuild=10, Refit=0.01})
extrude = Extrude(Base=loft, Direction=unit_z)
move = Move(Geometry=extrude, Motion=expr("-X*0.5", unit_z))  # -> Geometry, Transform
curve_3 = ClusterInput()
curve_4 = Curve(curve_3)
brep = Brep(move.Geometry)
explode = Explode(Curve=curve_4, Recursive=True)  # -> simplify(graft(Segments)), Vertices
trim_with_breps = TrimWithBreps(Curve=explode.Segments, Brep=flatten(brep))  # -> Inside, Outside
longest_list = LongestList(ListListA=trim_with_breps.Outside, ListListB=curve_4, PaddingMode=2)  # -> simplify(ListListA), simplify(ListListB)
flip_curve = FlipCurve(Curve=simplify(longest_list.ListListA), Guide=longest_list.ListListB)  # -> Curve, Flag
curve_5 = Curve(flip_curve.Curve)
curve_6 = ClusterOutput(curve_5)

# ==== cluster Flip
plane = ClusterInput()
plane_2 = Plane(plane)
deconstruct_plane = DeconstructPlane(Plane=plane_2)  # -> Origin, XAxis, YAxis, ZAxis
negative = Negative(Value=deconstruct_plane.XAxis)
mirror = Mirror(Plane=plane_2)  # -> Geometry, Transform
construct_plane = ConstructPlane(Origin=deconstruct_plane.Origin, XAxis=negative, YAxis=deconstruct_plane.YAxis)
orient = Orient(Source=PlaneXY(0, 0, 0), Target=construct_plane)  # -> Geometry, Transform
transform = Transform(construct_plane)
merge = Merge(Data1=transform, Data2=mirror.Transform)
compound = Compound(Transforms=merge)
transform_2 = Transform(compound)
transform_3 = ClusterOutput(transform_2)
plane_3 = Plane(construct_plane)
plane_4 = ClusterOutput(plane_3)
