# Grasshopper definition hops_test_units.gh (Grasshopper 1.0.7)
# plug-ins: Speckle 2

mesh_sphere = MeshSphere(Base=PlaneXY(0, 0, 0), Radius=10, UCount=10, VCount=20)
get_geometry = GetGeometry(mesh_sphere, AtLeast=1, AtMost=1, DeleteInput=False, Filter=1074004029, TreeAccess=False)
c_script = CSharpScript(x=get_geometry)  # -> out, A, B
# ---------- c_script: C# ----------
    var newDoc = RhinoDoc.CreateHeadless("");
    newDoc.ModelUnitSystem = UnitSystem.Feet;
    RhinoDoc.ActiveDoc = newDoc;
    A = Rhino.RhinoDoc.ActiveDoc.ModelUnitSystem;
    B = x;
# ---------- end c_script ----------
to_speckle = ToSpeckle(Data=c_script.B, preprocessGeometry=False, selectedKitName="Objects")
panel = Panel(c_script.A)
deconstruct_speckle_object = DeconstructSpeckleObject(SpeckleObject=to_speckle, selectedKitName="Objects")  # -> Area, Bbox, Colors, Faces, TextureCoordinates, TextureCoordinatesCount, Units, Vertices, VerticesCount, Volume
context_print = ContextPrint(DocUnits=c_script.A)
context_print_2 = ContextPrint(Text=deconstruct_speckle_object.Units)
